# Grasshopper definition example.gh (Grasshopper 1.0.7)
# plug-ins: THERB-GH, baues-toolbox Info

srf = Surface([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])
# 失敗ケース
brep = Brep([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])

# ----
# 成功ケース
brep_2 = Brep([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])
srf_2 = Surface([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])

brep_3 = Brep([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])
srf_3 = Surface(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)

brep_4 = Brep([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])
srf_4 = Surface([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])

brep_5 = Brep([<brep referenced from the Rhino model> x15])
srf_5 = Surface([<surface referenced from the Rhino model> x3])
exportw = ExportW()
readconstruction = ReadConstruction(Run=Toggle(True))
therb = THERB(Boxes=brep, Windows=srf, Tolerance=0.1)  # -> Therb, Test
panel = Panel(exportw)

number_slider = Slider(0.1, range=0..0.1)
windows_split = Surface([<surface referenced from the Rhino model> x3])
# step1. ジオメトリ、条件入力
rooms_split = Brep([<brep referenced from the Rhino model> x20])

panel_2 = Panel(readconstruction)
# 北の方角を指定
vec = Vector()
# タスク13.fiterFaceByPropertyを実装
decompose = Decompose(Therb=therb.Therb)  # -> Rooms, Faces, Windows, Overhangs
brep_6 = Brep([<brep referenced from the Rhino model> x3])
brep_7 = Brep([<brep referenced from the Rhino model> x2])
brep_8 = Brep([<brep referenced from the Rhino model> x3])
brep_9 = Brep([<brep referenced from the Rhino model> x2])
filterfacebyproperty = FilterFaceByProperty(Faces=decompose.Faces, Bc=1, SurfT=0, Direction=-1)  # -> TrueFace, FalseFace
srf_6 = Surface(<surface referenced from the Rhino model>)
srf_7 = Surface(<surface referenced from the Rhino model>)
therb_2 = THERB(Geometries=brep_8, Tolerance=Slider(0.1, range=0.1..10))  # -> Therb, Test
readfaceproperty = ReadFaceProperty(Faces=filterfacebyproperty.TrueFace)  # -> RoomId, PartId, Surface, ElementType, Normal, CenterPt, Direction, AdjacencyRoomId, Windows, WindowIds
item = CherryPicker(therb_2.Test, ListIndex=0)
digit_scroller = DigitScroller(Scroller_Digits=12, Scroller_Prefix="Index", Scroller_Radix=11, Scroller_Value=13)
updateconstruction = UpdateConstruction(Face=filterfacebyproperty.TrueFace)
python = GhPythonScript(x=brep_9, y=srf_7)  # -> out, a; inputs x: list
# ---------- python: Python ----------
a = [x, y]
# ---------- end python ----------
exportb = ExportB(Therb=therb.Therb)
exportr = ExportR(Therb=therb.Therb)
run_simulation = RunSimulation(Therb=therb.Therb, Name="TEST", Run=Toggle(False))
item_2 = ListItem(Index=digit_scroller, Wrap=True)
srf_8 = Surface()

r_datファイル書き出し = Panel(exportr)
# step2. 出力をチェック
b_datファイル書き出し = Panel(exportb)

# ----
# step03.
# サーバーにuploadする
# ための情報を入力
# step03-1. サーバーのドメイン入力
# (今のところ、ここは変える必要ないです）
# step03-2. プロジェクト名を入力
# step03-3. Trueにするとuploadして計算開始
panel_3 = Panel("http://localhost:5000/run")

# ----
# step04.
# サーバーからのresponseが表示されます。
# successとなっていれば、以下のurlをchrome
# で表示してください
# step05.
# 計算結果をPythonを利用してさらに分析することができます。
# 以下に分析例をまとめたJupyter Notebookを置いています。
# https://github.com/becat-oss/therb-notebook
uploadtherb = UploadTherb(Url=panel_3, ProjectName="demo2", Upload=Toggle(True))
